# Grasshopper definition 101_primitives_and_subdivisions_ex.ghx (Grasshopper 1.0.8)

py3 = Python3Script(radius=Slider(4, range=0..100), num_sides=Slider(10, range=0..10))  # -> out, new_mesh_rhino; inputs radius: Double, num_sides: Int32; unedited script template
geo = Geometry(py3.new_mesh_rhino)

# ----
# mesh from scratch
py3_2 = Python3Script(mola_path="C:\\Users\\akango\\Documents\\GitHub")  # -> out, a; inputs mola_path: String
# ---------- py3_2: Python ----------
import sys

if mola_path not in sys.path:
    sys.path.append(mola_path)

print(sys.path)

try:
    import mola
    from mola import module_rhino
except ImportError as e:
    print("Error importing mola: {e}")
# ---------- end py3_2 ----------

number_slider = Slider(5, range=0..10)
number_slider_2 = Slider(-7, range=-10..10)
# primitives
py3_3 = Python3Script(x=number_slider, y=number_slider, z=number_slider, x1=number_slider_2, y1=number_slider_2, z1=number_slider_2)  # -> out, my_mesh, my_mesh_rhino; unedited script template
# subdivision
py3_4 = Python3Script(mesh=py3_3.my_mesh, r=Slider(3, range=0..10))  # -> out, new_mesh, my_mesh_rhino; inputs r: Int32; unedited script template
py3_5 = Python3Script(mesh=py3_4.new_mesh)  # -> out, new_mesh, my_mesh_rhino; unedited script template
