# Grasshopper definition 103_branching_out_sticks.ghx (Grasshopper 1.0.8)

xy_plane = XYPlane(Origin=Point(0, 0, 0))
python_3_script = Python3Script(root=xy_plane, stick_length=Slider(200, range=0..1000))  # -> out, geometries, frame
# ---------- python_3_script: Python ----------
# r: compas>=2.14.1
# venv: sticks

import sys
import os
import math

#get current file path
path = ghenv.Component.OnPingDocument().FilePath
print (path)
#get parent directory of the parent directory
parentdir = os.path.dirname(path)
print (parentdir)
#get src folder which contains classes
dire = os.path.join(parentdir,'scripts')
print (dire)

sys.path.append(dire)

from compas_rhino import unload_modules

unload_modules("Sticks")
unload_modules("stick_module")

import Sticks
from Sticks import Stick 
from stick_module import BranchingModule
from compas.geometry import Line, Point, Vector, Frame, Rotation

stick_width = 13.0
stick_depth = 13.0


from compas_rhino.conversions import plane_to_compas_frame, frame_to_rhino_plane


# Convert input to compas
root = plane_to_compas_frame(root)
#R = Rotation.axis_and_angle(stick_axis, 60)
# Initialize tree
tree = BranchingModule(root, stick_length=200, width = stick_width, depth = stick_depth)


# Grow tree
tree.grow_stick(face_index = 0, angle = 125)
tree.grow_stick(face_index = 3, angle = -90)
#tree.grow_stick(face_index = 2, angle = 15)
# tree.grow_stick(from_stick_index = 0, face_index = 2, angle = 45)

# Visualize
geometries = tree.visualize()

frame = tree.visualize()
# ---------- end python_3_script ----------
draw = COMPASDraw(cg=python_3_script.geometries)  # -> rg
#   port cg: The COMPAS geometry or datastructure to be drawn.
#   port rg: The Rhino geometry object.
# ---------- draw: Python ----------
# r: compas>=2.14.1
"""
Draws COMPAS geometry in Grasshopper.
"""

from typing import Any

import Grasshopper

from compas.scene import SceneObject


class CompasToRhinoGeometry(Grasshopper.Kernel.GH_ScriptInstance):
    def RunScript(self, cg):
        if not cg:
            return None

        return SceneObject(item=cg).draw()
# ---------- end draw ----------
draw_2 = COMPASDraw(cg=python_3_script.frame)  # -> rg; same code as draw
