# Grasshopper definition Root_Frames_&_Bridges.gh (Grasshopper 1.0.8)
# plug-ins: Telepathy

# ---- group: LEGACY CODE
bridging = Python3Script()  # -> out, bridge_mode_A, bridge_mode_B, bridge_mode_C, gh_ghost_A, gh_ghost_B, gh_ghost_C, bridge_frames; inputs layered_sticks: list, mode: String, angle: String; disabled
# ---------- bridging: Python ----------
import Rhino.Geometry as rg
import math

# ======================================================
# PARAMETERS (LOCKED / SAFE DEFAULTS)
# ======================================================
BOX_W = 13.0
BOX_D = 13.0
OVERLAP = 0.05

MAX_BEND_DEG = angle if angle is not None else 150.0
max_distance = max_distance if max_distance is not None else 275.0
mode = mode if mode is not None else "ALL"

layered_sticks = layered_sticks if layered_sticks is not None else []

# ======================================================
# OUTPUT BUFFERS
# ======================================================
bridge_mode_A = []
bridge_mode_B = []
bridge_mode_C = []

gh_ghost_A = []
gh_ghost_B = []
gh_ghost_C = []

bridge_frames = []

# ======================================================
# BASIC HELPERS
# ======================================================
def unit(v):
    if v is None or v.Length < 1e-6:
        return None
    v.Unitize()
    return v

def angle_deg(v1, v2):
    return math.degrees(rg.Vector3d.VectorAngle(v1, v2))

def make_box(Fa, Fb):
    v = Fb.Origin - Fa.Origin
    L = v.Length
    if L < 1e-6:
        return None

    x = unit(rg.Vector3d(v))
    if x is None:
        return None

    y = rg.Vector3d(Fa.YAxis)
    y = y - x * (x * y)
    if y.Length < 1e-6:
        y = rg.Vector3d(Fa.ZAxis)   # ← fallback ONLY
        y = y - x * (x * y)
    y = unit(y)
    if y is None:
        return None


    pl = rg.Plane(Fa.Origin, x, y)
    box = rg.Box(
        pl,
        rg.Interval(0, L),
        rg.Interval(-BOX_W/2, BOX_W/2),
        rg.Interval(-BOX_D/2, BOX_D/2)
    )
    return box.ToBrep()

# ======================================================
# BEND POINT (POINT ONLY)
# ======================================================
def compute_bend(S, T, surf_plane):
    chord = T - S
    d = chord.Length
    if d < 1e-6:
        return None

    u = unit(rg.Vector3d(chord))
    n = unit(rg.Vector3d(surf_plane.ZAxis))
    v = unit(rg.Vector3d.CrossProduct(n, u))

    if u is None or n is None or v is None:
        return None

    M = rg.Point3d(
        0.5*(S.X+T.X),
        0.5*(S.Y+T.Y),
        0.5*(S.Z+T.Z)
    )

    h = (d*0.5) / math.tan(math.radians(MAX_BEND_DEG/2))

    for sign in (1.0, -1.0):
        B = M + v * (sign * h)
        a = angle_deg(S-B, T-B)
        if a <= MAX_BEND_DEG:
            return B

    return None

# ======================================================
# DIAGNOSTIC HEADER
# ======================================================
print("BRIDGE DEBUG")
print("Layers:", len(layered_sticks))
print("Mode:", mode)
print("MaxDist:", max_distance)
print("MaxBend:", MAX_BEND_DEG)

# ======================================================
# MODE A — FIXED FRAME SELECTION
# ======================================================
for layer in layered_sticks:

    group_Y = layer.get("Y", {})
    group_Z = layer.get("Z", {})

    sticks_Y = group_Y.get("sticks", [])
    sticks_Z = group_Z.get("sticks", [])

    if not sticks_Y or not sticks_Z:
        continue

    # ---- LAST CHILD MID FRAMES ----
    sy = sticks_Y[-1]
    sz = sticks_Z[-1]

    if not isinstance(sy.geometry, rg.Box):
        continue
    if not isinstance(sz.geometry, rg.Box):
        continue

    plY = sy.geometry.Plane
    plZ = sz.geometry.Plane

    # SAME SURFACE ONLY
    if abs(plY.DistanceTo(plZ.Origin)) > 1.0:
        continue

    def mid_frame(stick):
        g = stick.geometry
        pl = g.Plane
        xmid = 0.5 * (g.X.T0 + g.X.T1)
        origin = pl.Origin + pl.XAxis * xmid
        return rg.Plane(origin, pl.XAxis, pl.YAxis)

    Fs = mid_frame(sy)
    Ft = mid_frame(sz)

    gh_ghost_A.append(rg.Line(Fs.Origin, Ft.Origin))

    d = Fs.Origin.DistanceTo(Ft.Origin)

    if d <= max_distance:
        brep = make_box(Fs, Ft)
        if brep:
            bridge_mode_A.append(brep)
            bridge_frames.extend([Fs, Ft])
    else:
        Bp = compute_bend(Fs.Origin, Ft.Origin, plY)
        if not Bp:
            continue

        Fb = rg.Plane(Bp, Fs.XAxis, Fs.YAxis)

        for F0, F1 in ((Fs, Fb), (Fb, Ft)):
            brep = make_box(F0, F1)
            if brep:
                bridge_mode_A.append(brep)
                bridge_frames.extend([F0, F1])

print("A:", len(bridge_mode_A), "B:", len(bridge_mode_B), "C:", len(bridge_mode_C))
# ---------- end bridging ----------
bridging_2 = Python3Script()  # -> out, bridge_mode_A, bridge_mode_B, bridge_mode_C, gh_ghost_A, gh_ghost_B, gh_ghost_C, bridge_frames; disabled
bridging_3 = Python3Script()  # -> out, bridge_mode_A, bridge_mode_B, bridge_mode_C, gh_ghost_A, gh_ghost_B, gh_ghost_C, bridge_frames; disabled
bridging_4 = Python3Script()  # -> out, bridge_mode_A, bridge_mode_B, bridge_mode_C, gh_ghost_A, gh_ghost_B, gh_ghost_C, bridge_frames; disabled
swatch = ColourSwatch(SwatchColor=RGB(217, 62, 189))
swatch_2 = ColourSwatch(SwatchColor=RGB(217, 62, 189))
swatch_3 = ColourSwatch(SwatchColor=RGB(217, 62, 189))
swatch_4 = ColourSwatch(SwatchColor=RGB(217, 62, 189))

# ---- group: SAMPLING+BRANCHING
number_slider = Slider(200, range=0..250)
geo = Geometry([<surface referenced from the Rhino model> x4])
gen_rhplanes = Python3Script(
    surface=geo,
    point_density=Slider(300, range=0..500),
    point_randomness=Slider(1, range=0..1),
    min_stick_length=number_slider)  # -> out, list_pts, rootplanes, plane_geos; inputs surface: Surface, point_density: Int32, point_randomness: Double, min_stick_length: Int32
# ---------- gen_rhplanes: Python ----------
import Rhino.Geometry as rg
import random


# INPUT VALIDATION

if surface is None or not isinstance(surface, rg.Surface):
    raise ValueError("Input 'surface' must be a Rhino.Geometry.Surface")

if point_density is None or point_density < 2:
    raise ValueError("sample_density must be >= 2")

if point_density is None or point_density < 1:
    point_density = 10

if point_randomness is None:
    point_randomness = 1.0

# PARAMETERS


min_spacing = 1.5 * min_stick_length
edge_offset = 0.4 * min_stick_length


# UV GRID (CONTROLLED BY sample_density)


u_dom = surface.Domain(0)
v_dom = surface.Domain(1)

u_len = u_dom.Length
v_len = v_dom.Length

# normalized buffer (edge inset)
u_buf = edge_offset / u_len if u_len > 0 else 0.0
v_buf = edge_offset / v_len if v_len > 0 else 0.0

u_count = int(point_density)
v_count = int(point_density)

uv_candidates = []

for i in range(u_count + 1):
    for j in range(v_count + 1):

        u = u_dom.T0 + u_len * (i / float(u_count))
        v = v_dom.T0 + v_len * (j / float(v_count))

        u_n = (u - u_dom.T0) / u_len
        v_n = (v - v_dom.T0) / v_len

        # trim away edges
        if u_n <= u_buf or u_n >= 1.0 - u_buf:
            continue
        if v_n <= v_buf or v_n >= 1.0 - v_buf:
            continue

        uv_candidates.append((u, v))


# RANDOMIZED SAMPLING (SOFT FILTERS)

random.shuffle(uv_candidates)

accepted_pts = []
accepted_planes = []
rejected_pts = []

for (u, v) in uv_candidates:

    if len(accepted_pts) >= point_density:
        break

    # randomness gate 
    if random.random() > point_randomness:
        rejected_pts.append(surface.PointAt(u, v))
        continue

    pt = surface.PointAt(u, v)
    normal = surface.NormalAt(u, v)

    if not normal.IsValid or normal.Length < 1e-6:
        rejected_pts.append(pt)
        continue

    # soft spacing penalty
    too_close = False
    for p in accepted_pts:
        if pt.DistanceTo(p) < min_spacing * random.uniform(0.6, 1.2):
            too_close = True
            break

    if too_close:
        rejected_pts.append(pt)
        continue

    plane = rg.Plane(pt, normal)

    accepted_pts.append(pt)
    accepted_planes.append(plane)


# PLANE AXIS PREVIEW


plane_geos = []
axis_len = 0.25 * min_stick_length

for pl in accepted_planes:
    o = pl.Origin
    plane_geos.append(rg.Line(o, o + pl.XAxis * axis_len))
    plane_geos.append(rg.Line(o, o + pl.YAxis * axis_len))
    plane_geos.append(rg.Line(o, o + pl.ZAxis * axis_len))


# OUTPUTS


list_pts = accepted_pts
rootplanes = accepted_planes
plane_geos = plane_geos
rejected_pts = rejected_pts
# ---------- end gen_rhplanes ----------
rhplanes_to_frames = Python3Script(rootplanes=flatten(gen_rhplanes.rootplanes), source_surfaces=geo, stick_length=number_slider)  # -> out, paired_root_frames, paired_origins, family_labels_output, growth_directions_rg, direction_lines, qa_visual_tags, qa_visual_roots; inputs rootplanes: list of Plane, source_surfaces: list of Surface, stick_length: Int32
# ---------- rhplanes_to_frames: Python ----------
import Rhino.Geometry as rg
from compas.geometry import Frame, Point, Vector, distance_point_point
from collections import defaultdict


# Validate Inputs

if not source_surfaces or not rootplanes:
    raise ValueError("Missing input surfaces or planes.")


# Assign each plane to its closest surface (perpendicular distance)

plane_surface_ids = []
for i, pl in enumerate(rootplanes):
    pt = pl.Origin
    closest_sid = None
    closest_dist = float("inf")

    for sid, surf in enumerate(source_surfaces):
        result, surf_plane = surf.TryGetPlane()
        if not result:
            continue
        d = abs(surf_plane.DistanceTo(pt))
        if d < closest_dist:
            closest_dist = d
            closest_sid = sid

    plane_surface_ids.append(closest_sid)


# Assign families alternating *within* each surface group

surface_plane_indices = defaultdict(list)
for idx, sid in enumerate(plane_surface_ids):
    surface_plane_indices[sid].append(idx)

family_labels = [None] * len(rootplanes)
for sid, indices in surface_plane_indices.items():
    for j, i in enumerate(indices):
        family_labels[i] = "Y" if j % 2 == 0 else "Z"


# Surface type definitions

surface_types = {
    0: "outer",
    1: "outer",
    2: "inner",
    3: "inner"
}


# Organize frames into structured dictionary

structured = {}
for i, pl in enumerate(rootplanes):
    if not isinstance(pl, rg.Plane):
        continue

    origin = pl.Origin
    xaxis = pl.XAxis
    yaxis = pl.YAxis

    frame = Frame(
        Point(origin.X, origin.Y, origin.Z),
        Vector(xaxis.X, xaxis.Y, xaxis.Z),
        Vector(yaxis.X, yaxis.Y, yaxis.Z)
    )

    sid = plane_surface_ids[i]
    fam = family_labels[i]
    surface_type = surface_types.get(sid, "outer")

    key = (sid, fam)
    if key not in structured:
        structured[key] = {
            "surface_id": sid,
            "family": fam,
            "type": surface_type,
            "frames": []
        }
    structured[key]["frames"].append(frame)


# Pairing: root → closest frame in same group and correct direction

paired = []
direction_lines = []
qa_dots = []
qa_tags = []

for key, group in structured.items():
    frames = group["frames"]
    surface_type = group["type"]
    sid = group["surface_id"]
    fam = group["family"]

    if len(frames) < 2:
        continue

    sorted_frames = sorted(frames, key=lambda f: f.point.z)

    for i, root in enumerate(sorted_frames):
        root_pt = root.point
        closest = None
        min_dist = float("inf")

        for f in frames:
            if f is root:
                continue

            dz = f.point.z - root_pt.z
            if surface_type == "outer" and dz <= 0:
                continue
            if surface_type == "inner" and dz >= 0:
                continue

            dist = distance_point_point(root_pt, f.point)
            if dist < min_dist:
                closest = f
                min_dist = dist

        if closest:
            direction = closest.point - root_pt
            normal = root.normal
            direction_proj = (direction - direction.dot(normal) * normal).unitized()

            xaxis = direction_proj
            yaxis = normal.cross(xaxis).unitized()
            new_frame = Frame(root_pt, xaxis, yaxis)

            paired.append((new_frame, direction_proj))

            # QA tag for root
            dot_text = f"ROOT | SID {sid} | L{i+1}"
            qa_dots.append(rg.Point3d(root_pt.x, root_pt.y, root_pt.z))
            qa_tags.append(rg.TextDot(dot_text, rg.Point3d(root_pt.x, root_pt.y, root_pt.z)))


# Output for Grasshopper

paired_root_frames = [p[0] for p in paired]
growth_directions = [p[1] for p in paired]
growth_directions_rg = [rg.Vector3d(v.x, v.y, v.z) for v in growth_directions]
paired_origins = [rg.Point3d(f.point.x, f.point.y, f.point.z) for f in paired_root_frames]

# Outputs
qa_visual_dots = qa_dots
qa_visual_tags = qa_tags
family_labels_output = family_labels
# ---------- end rhplanes_to_frames ----------
panel = Panel(gen_rhplanes.list_pts)
panel_2 = Panel(rhplanes_to_frames.family_labels_output)
draw = COMPASDraw(cg=rhplanes_to_frames.paired_root_frames)  # -> rg
#   port cg: The COMPAS geometry or datastructure to be drawn.
#   port rg: The Rhino geometry object.
# ---------- draw: Python ----------
# r: compas>=2.14.1
"""
Draws COMPAS geometry in Grasshopper.
"""

from typing import Any

import Grasshopper

from compas.scene import SceneObject


class CompasToRhinoGeometry(Grasshopper.Kernel.GH_ScriptInstance):
    def RunScript(self, cg):
        if not cg:
            return None

        return SceneObject(item=cg).draw()
# ---------- end draw ----------
branching = Python3Script(
    surface=geo,
    paired_root_frames=rhplanes_to_frames.paired_root_frames,
    family_labels_output=rhplanes_to_frames.family_labels_output,
    direction_lines=rhplanes_to_frames.direction_lines,
    growth_directions_rg=rhplanes_to_frames.growth_directions_rg,
    stick_angle=Slider(60, range=0..90),
    offset=Slider(15, range=0..200))  # -> out, parent_frames, geometries, layered_sticks, axes, flat_sticks; inputs surface: Surface, paired_root_frames: list, family_labels_output: String, direction_lines: list, growth_directions_rg: list, stick_angle: Int32, offset: Int32
# ---------- branching: Python ----------
import sys
import os
import math
import traceback
import Rhino.Geometry as rg

# ------------------------------------------------------------
# SETUP
# ------------------------------------------------------------

path = ghenv.Component.OnPingDocument().FilePath
parentdir = os.path.dirname(path)
scripts_dir = os.path.join(parentdir, "scripts")
if scripts_dir not in sys.path:
    sys.path.append(scripts_dir)

from compas.geometry import Frame, Vector
from compas_rhino import unload_modules
from branch import BranchingModule

unload_modules("branch")

# ------------------------------------------------------------
# INPUT VALIDATION
# ------------------------------------------------------------

if not paired_root_frames or not growth_directions_rg:
    raise ValueError("Missing inputs: paired_root_frames or growth_directions_rg")

# Surface type map (explicit, stable)
surface_types = {
    0: "outer",
    1: "outer",
    2: "inner",
    3: "inner"
}

# Normalize family labels (Y / Z alternating)
if not family_labels_output:
    family_labels_output = ["Y"]

if len(family_labels_output) == 1:
    family_labels_output = family_labels_output * len(paired_root_frames)

family_labels_output = [
    "Y" if i % 2 == 0 else "Z"
    for i in range(len(paired_root_frames))
]

# ------------------------------------------------------------
# CONSTANTS
# ------------------------------------------------------------

stick_length = 150.0
stick_width  = 13.0
stick_depth  = 13.0
stick_angle  = stick_angle if "stick_angle" in globals() else 35.0
offset       = offset if "offset" in globals() else 20.0

ANGLE_STEPS = [0, -15, -30, -45, -60, -75, -90]

# ------------------------------------------------------------
# HELPERS
# ------------------------------------------------------------

def group_by_height(data, h=125.0):
    """Group (frame, vec, label, surface_id) tuples into height layers."""
    layers = []
    current = []
    z0 = data[0][0].point.z

    for item in data:
        if item[0].point.z - z0 < h:
            current.append(item)
        else:
            layers.append(current)
            current = [item]
            z0 = item[0].point.z

    if current:
        layers.append(current)

    return layers


def grow_group(
    group,
    face_index,
    surface_id,
    surface_type,
    layer_id,
    family,
    collision_pool
):
    """Grow sticks for one (surface, layer, family) group."""
    for frame_index, (root_frame, vec_rg, _, _) in enumerate(group):

        # Growth direction
        xaxis = Vector(vec_rg.X, vec_rg.Y, vec_rg.Z).unitized()

        ref = (
            root_frame.zaxis
            if abs(xaxis.dot(root_frame.zaxis)) < 0.95
            else root_frame.yaxis
        )

        yaxis = ref.cross(xaxis).unitized()
        zaxis = xaxis.cross(yaxis).unitized()

        base_point = root_frame.point - xaxis * (0.1 * stick_length)
        base_frame = Frame(base_point, xaxis, yaxis)

        best_tree = None

        for a in ANGLE_STEPS:
            f = base_frame.copy()
            f.rotate(math.radians(a), zaxis)

            tree = BranchingModule(
                f,
                stick_length=stick_length,
                width=stick_width,
                depth=stick_depth
            )

            tree.grow_stick(
                from_stick_index=0,
                face_index=face_index,
                angle=stick_angle,
                offset=offset
            )

            if len(tree.sticks) >= 2:
                best_tree = tree
                break

        if not best_tree:
            continue

        # ---- METADATA ATTACHMENT (Option B) ----
        for s in best_tree.sticks:
            s.surface_id   = surface_id
            s.surface_type = surface_type
            s.layer        = layer_id
            s.family       = family
            s.frame_index  = frame_index

            collision_pool.append(s)

# ------------------------------------------------------------
# MAIN
# ------------------------------------------------------------

collision_pool = []
all_geom = []
layered = []

try:
    from ghpythonlib import treehelpers

    # Build paired list: (frame, vector, family, surface_id)
    paired = []

    if hasattr(paired_root_frames, "BranchCount"):
        frames_tree = treehelpers.tree_to_list(paired_root_frames)
        vecs_tree   = treehelpers.tree_to_list(growth_directions_rg)

        k = 0
        for surface_id, (f_branch, v_branch) in enumerate(zip(frames_tree, vecs_tree)):
            for f, v in zip(f_branch, v_branch):
                paired.append((f, v, family_labels_output[k], surface_id))
                k += 1
    else:
        for i, (f, v) in enumerate(zip(paired_root_frames, growth_directions_rg)):
            paired.append((f, v, family_labels_output[i], 0))

    # ---- GROUP BY SURFACE ----
    from collections import defaultdict
    paired_by_surface = defaultdict(list)

    for item in paired:
        paired_by_surface[item[3]].append(item)

    # ---- PROCESS EACH SURFACE ----
    for surface_id, items in paired_by_surface.items():

        items.sort(key=lambda p: p[0].point.z)
        layers = group_by_height(items)

        surf_type = surface_types.get(surface_id, "outer")

        for layer_id, layer in enumerate(layers):

            group_Y = [i for i in layer if i[2] == "Y"]
            group_Z = [i for i in layer if i[2] == "Z"]

            grow_group(
                group_Y,
                face_index=3,
                surface_id=surface_id,
                surface_type=surf_type,
                layer_id=layer_id,
                family="Y",
                collision_pool=collision_pool
            )

            grow_group(
                group_Z,
                face_index=2,
                surface_id=surface_id,
                surface_type=surf_type,
                layer_id=layer_id,
                family="Z",
                collision_pool=collision_pool
            )

except Exception:
    print(traceback.format_exc())

# ------------------------------------------------------------
# OUTPUTS
# ------------------------------------------------------------

flat_sticks = collision_pool
geometries = [s.geometry for s in collision_pool]
axes = [s.axis for s in collision_pool]
layered_sticks = None
qa_collision_report = None

print("STICKS:", len(collision_pool))
# ---------- end branching ----------
draw_2 = COMPASDraw(cg=branching.geometries)  # -> rg; disabled; same code as draw
preview = CustomPreview(Geometry=branching.flat_sticks, Material=ColourSwatch(SwatchColor=RGB(244, 0, 25)))

# ----
swatch_5 = ColourSwatch(SwatchColor=RGB(0, 255, 0))  # disabled
swatch_6 = ColourSwatch(SwatchColor=RGB(255, 0, 0))  # disabled
swatch_7 = ColourSwatch(SwatchColor=RGB(6, 0, 255))  # disabled

number_slider_2 = Slider(9, range=0..10)  # disabled
py3 = Python3Script(frames=rhplanes_to_frames.paired_root_frames, scale=number_slider_2)  # -> out, x_lines, y_lines, z_lines; inputs frames: list, scale: Double; disabled
# ---------- py3: Python ----------
import Rhino.Geometry as rg
from compas.geometry import Point, Vector

# Inputs: frames (list[Frame]), scale (float)

x_lines = []
y_lines = []
z_lines = []

for f in frames:
    origin = f.point
    x_end = origin + f.xaxis.scaled(scale)
    y_end = origin + f.yaxis.scaled(scale)
    z_end = origin + f.zaxis.scaled(scale)

    x_lines.append(rg.Line(rg.Point3d(*origin), rg.Point3d(*x_end)))
    y_lines.append(rg.Line(rg.Point3d(*origin), rg.Point3d(*y_end)))
    z_lines.append(rg.Line(rg.Point3d(*origin), rg.Point3d(*z_end)))
# ---------- end py3 ----------
preview_2 = CustomPreview(Geometry=py3.x_lines, Material=swatch_6)  # disabled
preview_3 = CustomPreview(Geometry=py3.y_lines, Material=swatch_5)  # disabled
preview_4 = CustomPreview(Geometry=py3.z_lines, Material=swatch_7)  # disabled

swatch_8 = ColourSwatch(SwatchColor=RGB(0, 0, 250))
geo_2 = Geometry(gen_rhplanes.list_pts)
geo_3 = Geometry(rhplanes_to_frames.qa_visual_roots)
preview_5 = CustomPreview(Geometry=gen_rhplanes.plane_geos, Material=ColourSwatch(SwatchColor=RGB(232, 241, 30)))
preview_6 = CustomPreview(Geometry=rhplanes_to_frames.direction_lines, Material=swatch_8)
tag = TextTag(Location=rhplanes_to_frames.paired_origins, Text=rhplanes_to_frames.family_labels_output, Colour=swatch_8)
panel_3 = Panel(branching.flat_sticks)
height_subdiv = Slider(2, range=0..30)  # disabled
twist_angle = Slider(11, range=0..30)  # disabled
max_height = Slider(126, range=0..200)  # disabled
preview_7 = CustomPreview(Geometry=branching.geometries, Material=ColourSwatch(SwatchColor=RGB(232, 140, 25)))
layers = Slider(80, range=0..100)  # disabled
draw_3 = COMPASDraw(cg=branching.axes)  # -> rg; same code as draw

# ---- group: BRIDGING
number_slider_3 = Slider(100, range=0..500)  # disabled
number_slider_4 = Slider(100, range=0..500)  # disabled
number_slider_5 = Slider(0, range=0..100)  # disabled
number_slider_6 = Slider(0, range=0..100)  # disabled
number_slider_7 = Slider(1500, range=0..1500)  # disabled
number_slider_8 = Slider(1500, range=0..1500)  # disabled
bridging_mode_b = Python3Script(
    layered_sticks=branching.layered_sticks,
    max_distance=number_slider_7,
    BRIDGE_STICK_LENGTH=number_slider_3,
    OVERLAP_RATIO=number_slider_5)  # -> out, bridge_mode_B, gh_ghost_B, bridge_frames; inputs layered_sticks: list, OVERLAP_RATIO: String; disabled
# ---------- bridging_mode_b: Python ----------
import traceback
import sys
import os
import math
import Rhino.Geometry as rg
from compas_rhino import unload_modules


# SETUP PATHS

path = ghenv.Component.OnPingDocument().FilePath
parentdir = os.path.dirname(path) if path else ""
scripts_dir = os.path.join(parentdir, "scripts") if parentdir else ""
if scripts_dir and scripts_dir not in sys.path:
    sys.path.append(scripts_dir)

unload_modules("Sticks")

try:
    from Sticks import Stick
except Exception:
    Stick = None

print("\n=== BRIDGE PAIRWISE DEBUG START ===")

try:
    
    # PARAMETERS (UNCHANGED)
    
    BOX_WIDTH = 13.0
    BOX_DEPTH = 13.0

    BRIDGE_STICK_LENGTH = 275.0
    TWO_SEG_THRESHOLD = 0.8 * BRIDGE_STICK_LENGTH
    MAX_BEND_ANGLE_DEG = 150.0

    OVERLAP_RATIO = 0.05

    
    # DATA TREE NORMALIZATION
    
    layered_groups = layered_sticks if layered_sticks is not None else []

    try:
        from ghpythonlib import treehelpers
        if hasattr(layered_groups, "BranchCount"):
            layered_groups = treehelpers.tree_to_list(layered_groups)
    except Exception:
        pass

    if isinstance(layered_groups, list) and layered_groups:
        if isinstance(layered_groups[0], list):
            if len(layered_groups[0]) == 1 and isinstance(layered_groups[0][0], dict):
                layered_groups = [b[0] for b in layered_groups]

    
    # FRAME CONSTRUCTION
    
    def stick_mid_face_frame(stick, sign):
        g = stick.geometry
        pl = g.Plane
        xmid = 0.5 * (g.X.T0 + g.X.T1)
        y = g.Y.T1 if sign > 0 else g.Y.T0
        origin = pl.Origin + pl.XAxis * xmid + pl.YAxis * y
        return rg.Plane(origin, pl.XAxis, pl.YAxis)

    def stick_end_face_frame(stick, sign):
        g = stick.geometry
        pl = g.Plane
        x = g.X.T1 if sign > 0 else g.X.T0
        ymid = 0.5 * (g.Y.T0 + g.Y.T1)
        origin = pl.Origin + pl.XAxis * x + pl.YAxis * ymid
        return rg.Plane(origin, pl.XAxis, pl.YAxis)

    
    # FACE & OFFSET HELPERS
    
    def apply_face_choice(frame, use_Z, face_sign):
        X = rg.Vector3d(frame.XAxis); X.Unitize()
        Y = rg.Vector3d(frame.ZAxis if use_Z else frame.YAxis) * face_sign
        Y.Unitize()
        Z = rg.Vector3d.CrossProduct(X, Y); Z.Unitize()
        Y = rg.Vector3d.CrossProduct(Z, X); Y.Unitize()
        return rg.Plane(frame.Origin, X, Y)

    def apply_x_overlap(frame, sign):
        o = rg.Point3d(frame.Origin)
        x = rg.Vector3d(frame.XAxis); x.Unitize()
        o += x * sign * (OVERLAP_RATIO * BRIDGE_STICK_LENGTH)
        return rg.Plane(o, frame.XAxis, frame.YAxis)

    
    # BEND GEOMETRY (UNCHANGED)
    
    def bend_angle_at(B, S, T):
        v1 = rg.Vector3d(S - B)
        v2 = rg.Vector3d(T - B)
        v1.Unitize(); v2.Unitize()
        return math.degrees(rg.Vector3d.VectorAngle(v1, v2))

    def compute_bend_point(S, T, surface_plane):
        chord = rg.Vector3d(T - S)
        d = chord.Length
        if d <= 1e-9:
            return None
        u = rg.Vector3d(chord); u.Unitize()
        n = rg.Vector3d(surface_plane.ZAxis); n.Unitize()
        v = rg.Vector3d.CrossProduct(n, u); v.Unitize()
        M = rg.Point3d(
            0.5 * (S.X + T.X),
            0.5 * (S.Y + T.Y),
            0.5 * (S.Z + T.Z)
        )
        h = (d * 0.5) / math.tan(math.radians(MAX_BEND_ANGLE_DEG * 0.5))
        for s in (+1, -1):
            B = M + v * h * s
            if bend_angle_at(B, S, T) <= MAX_BEND_ANGLE_DEG:
                return B
        return None

    
    # BRIDGE BOX
    
    def make_bridge_box_from_frames(Fa, Fb):
        v = Fb.Origin - Fa.Origin
        if v.Length <= 1e-6:
            return None
        x = rg.Vector3d(v); x.Unitize()
        z = rg.Vector3d(Fb.ZAxis)
        y = rg.Vector3d.CrossProduct(z, x); y.Unitize()
        pl = rg.Plane(Fa.Origin, x, y)
        box = rg.Box(
            pl,
            rg.Interval(0, v.Length),
            rg.Interval(-BOX_WIDTH * 0.5, BOX_WIDTH * 0.5),
            rg.Interval(-BOX_DEPTH * 0.5, BOX_DEPTH * 0.5)
        )
        return box.ToBrep()


    
    # MODE B — END (LAST CHILD) → MID (INITIAL, REVERSED)
    
    bridges_B = []

    for layer in layered_groups:
        Y = layer.get("Y", {}).get("sticks", [])
        Z = layer.get("Z", {}).get("sticks", [])
        if not Y or not Z:
            continue

        F_S = stick_end_face_frame(Z[-1], +1)
        F_T = stick_mid_face_frame(Y[0], -1)

        F_S = apply_face_choice(F_S, True, +1)
        F_T = apply_face_choice(F_T, False, -1)

        F_S = apply_x_overlap(F_S, +1)
        F_T = apply_x_overlap(F_T, -1)

        d = F_S.Origin.DistanceTo(F_T.Origin)
        if d <= TWO_SEG_THRESHOLD:
            b = make_bridge_box_from_frames(F_S, F_T)
            if b: bridges_B.append(b)
        else:
            B = compute_bend_point(F_S.Origin, F_T.Origin, Z[-1].geometry.Plane)
            if not B: continue
            F_B = rg.Plane(B, Z[-1].geometry.Plane.XAxis, Z[-1].geometry.Plane.YAxis)
            bridges_B += filter(None, [
                make_bridge_box_from_frames(F_S, F_B),
                make_bridge_box_from_frames(F_B, F_T)
            ])

    bridge_mode_B = bridges_B


except Exception:
    print(traceback.format_exc())
    bridge_mode_B = []
# ---------- end bridging_mode_b ----------
bridging_mode_c = Python3Script(
    layered_sticks=branching.layered_sticks,
    max_distance=number_slider_8,
    BRIDGE_STICK_LENGTH=number_slider_4,
    OVERLAP_RATIO=number_slider_6)  # -> out, bridge_mode_C, gh_ghost_C, bridge_frames; inputs layered_sticks: list, OVERLAP_RATIO: String; disabled
# ---------- bridging_mode_c: Python ----------
import traceback
import sys
import os
import math
import Rhino.Geometry as rg
from compas_rhino import unload_modules


# SETUP PATHS

path = ghenv.Component.OnPingDocument().FilePath
parentdir = os.path.dirname(path) if path else ""
scripts_dir = os.path.join(parentdir, "scripts") if parentdir else ""
if scripts_dir and scripts_dir not in sys.path:
    sys.path.append(scripts_dir)

unload_modules("Sticks")

try:
    from Sticks import Stick
except Exception:
    Stick = None

print("\n=== BRIDGE PAIRWISE DEBUG START ===")

try:
   
    # PARAMETERS (UNCHANGED)
    
    BOX_WIDTH = 13.0
    BOX_DEPTH = 13.0

    BRIDGE_STICK_LENGTH = 275.0
    TWO_SEG_THRESHOLD = 0.8 * BRIDGE_STICK_LENGTH
    MAX_BEND_ANGLE_DEG = 150.0

    OVERLAP_RATIO = 0.05

    
    # DATA TREE NORMALIZATION
    
    layered_groups = layered_sticks if layered_sticks is not None else []

    try:
        from ghpythonlib import treehelpers
        if hasattr(layered_groups, "BranchCount"):
            layered_groups = treehelpers.tree_to_list(layered_groups)
    except Exception:
        pass

    if isinstance(layered_groups, list) and layered_groups:
        if isinstance(layered_groups[0], list):
            if len(layered_groups[0]) == 1 and isinstance(layered_groups[0][0], dict):
                layered_groups = [b[0] for b in layered_groups]

    
    # FRAME CONSTRUCTION
   
    def stick_mid_face_frame(stick, sign):
        g = stick.geometry
        pl = g.Plane
        xmid = 0.5 * (g.X.T0 + g.X.T1)
        y = g.Y.T1 if sign > 0 else g.Y.T0
        origin = pl.Origin + pl.XAxis * xmid + pl.YAxis * y
        return rg.Plane(origin, pl.XAxis, pl.YAxis)

    def stick_end_face_frame(stick, sign):
        g = stick.geometry
        pl = g.Plane
        x = g.X.T1 if sign > 0 else g.X.T0
        ymid = 0.5 * (g.Y.T0 + g.Y.T1)
        origin = pl.Origin + pl.XAxis * x + pl.YAxis * ymid
        return rg.Plane(origin, pl.XAxis, pl.YAxis)

    
    # FACE & OFFSET HELPERS
    
    def apply_face_choice(frame, use_Z, face_sign):
        X = rg.Vector3d(frame.XAxis); X.Unitize()
        Y = rg.Vector3d(frame.ZAxis if use_Z else frame.YAxis) * face_sign
        Y.Unitize()
        Z = rg.Vector3d.CrossProduct(X, Y); Z.Unitize()
        Y = rg.Vector3d.CrossProduct(Z, X); Y.Unitize()
        return rg.Plane(frame.Origin, X, Y)

    def apply_x_overlap(frame, sign):
        o = rg.Point3d(frame.Origin)
        x = rg.Vector3d(frame.XAxis); x.Unitize()
        o += x * sign * (OVERLAP_RATIO * BRIDGE_STICK_LENGTH)
        return rg.Plane(o, frame.XAxis, frame.YAxis)

    
    # BEND GEOMETRY (UNCHANGED)
    
    def bend_angle_at(B, S, T):
        v1 = rg.Vector3d(S - B)
        v2 = rg.Vector3d(T - B)
        v1.Unitize(); v2.Unitize()
        return math.degrees(rg.Vector3d.VectorAngle(v1, v2))

    def compute_bend_point(S, T, surface_plane):
        chord = rg.Vector3d(T - S)
        d = chord.Length
        if d <= 1e-9:
            return None
        u = rg.Vector3d(chord); u.Unitize()
        n = rg.Vector3d(surface_plane.ZAxis); n.Unitize()
        v = rg.Vector3d.CrossProduct(n, u); v.Unitize()
        M = rg.Point3d(
            0.5 * (S.X + T.X),
            0.5 * (S.Y + T.Y),
            0.5 * (S.Z + T.Z)
        )
        h = (d * 0.5) / math.tan(math.radians(MAX_BEND_ANGLE_DEG * 0.5))
        for s in (+1, -1):
            B = M + v * h * s
            if bend_angle_at(B, S, T) <= MAX_BEND_ANGLE_DEG:
                return B
        return None

    
    # BRIDGE BOX
    
    def make_bridge_box_from_frames(Fa, Fb):
        v = Fb.Origin - Fa.Origin
        if v.Length <= 1e-6:
            return None
        x = rg.Vector3d(v); x.Unitize()
        z = rg.Vector3d(Fb.ZAxis)
        y = rg.Vector3d.CrossProduct(z, x); y.Unitize()
        pl = rg.Plane(Fa.Origin, x, y)
        box = rg.Box(
            pl,
            rg.Interval(0, v.Length),
            rg.Interval(-BOX_WIDTH * 0.5, BOX_WIDTH * 0.5),
            rg.Interval(-BOX_DEPTH * 0.5, BOX_DEPTH * 0.5)
        )
        return box.ToBrep()

   
    # MODE C — MID (2ND LAST) → MID (2ND LAST, ADJACENT)
 
    bridges_C = []

    for layer in layered_groups:
        Y = layer.get("Y", {}).get("sticks", [])
        Z = layer.get("Z", {}).get("sticks", [])
        if len(Y) < 2 or len(Z) < 2:
            continue

        F_S = stick_mid_face_frame(Y[-2], +1)
        F_T = stick_mid_face_frame(Z[-2], +1)

        n1 = rg.Vector3d(F_S.YAxis); n1.Unitize()
        n2 = rg.Vector3d(F_T.YAxis); n2.Unitize()
        if abs(rg.Vector3d.Multiply(n1, n2)) > 0.2:
            continue

        F_S = apply_face_choice(F_S, False, +1)
        F_T = apply_face_choice(F_T, True, -1)

        F_S = apply_x_overlap(F_S, +1)
        F_T = apply_x_overlap(F_T, -1)

        d = F_S.Origin.DistanceTo(F_T.Origin)
        if d <= TWO_SEG_THRESHOLD:
            b = make_bridge_box_from_frames(F_S, F_T)
            if b: bridges_C.append(b)
        else:
            B = compute_bend_point(F_S.Origin, F_T.Origin, Y[-2].geometry.Plane)
            if not B: continue
            F_B = rg.Plane(B, Y[-2].geometry.Plane.XAxis, Y[-2].geometry.Plane.YAxis)
            bridges_C += filter(None, [
                make_bridge_box_from_frames(F_S, F_B),
                make_bridge_box_from_frames(F_B, F_T)
            ])

    bridge_mode_C = bridges_C

except Exception:
    print(traceback.format_exc())
    bridge_mode_C = []
# ---------- end bridging_mode_c ----------
bridging_mode_a = Python3Script(
    layered_sticks=branching.layered_sticks,
    max_distance=Slider(600, range=0..1500),
    BRIDGE_STICK_LENGTH=Slider(250, range=0..500),
    OVERLAP_RATIO=Slider(0, range=0..100))  # -> out, bridge_mode_A, gh_ghost_A, bridge_frames; inputs layered_sticks: list, OVERLAP_RATIO: String
# ---------- bridging_mode_a: Python ----------
import traceback
import sys
import os
import math
import Rhino.Geometry as rg
from compas_rhino import unload_modules


# ======================================================
# SETUP PATHS
# ======================================================

path = ghenv.Component.OnPingDocument().FilePath
parentdir = os.path.dirname(path) if path else ""
scripts_dir = os.path.join(parentdir, "scripts") if parentdir else ""
if scripts_dir and scripts_dir not in sys.path:
    sys.path.append(scripts_dir)

unload_modules("Sticks")

try:
    from Sticks import Stick
except Exception:
    Stick = None

print("\n=== MODE A — INTRA-SURFACE BRIDGING (SURFACE-LOCKED) ===")

try:

    # ======================================================
    # PARAMETERS
    # ======================================================

    BOX_WIDTH = 13.0
    BOX_DEPTH = 13.0

    BRIDGE_STICK_LENGTH = 200.0
    TWO_SEG_THRESHOLD = 0.8 * BRIDGE_STICK_LENGTH

    MAX_BEND_ANGLE_DEG = 150.0

    if max_distance is None:
        raise ValueError("max_distance input is required")

    # ======================================================
    # DATA TREE NORMALIZATION
    # ======================================================

    layered_groups = layered_sticks if layered_sticks is not None else []

    try:
        from ghpythonlib import treehelpers
        if hasattr(layered_groups, "BranchCount"):
            layered_groups = treehelpers.tree_to_list(layered_groups)
    except Exception:
        pass

    if isinstance(layered_groups, list) and layered_groups:
        if isinstance(layered_groups[0], list):
            if len(layered_groups[0]) == 1 and isinstance(layered_groups[0][0], dict):
                layered_groups = [b[0] for b in layered_groups]

    # ======================================================
    # FRAME HELPERS (SURFACE-LOCKED)
    # ======================================================

    def stick_mid_face_origin(stick, sign):
        g = stick.geometry
        pl = g.Plane
        xmid = 0.5 * (g.X.T0 + g.X.T1)
        y = g.Y.T1 if sign > 0 else g.Y.T0
        return pl.Origin + pl.XAxis * xmid + pl.YAxis * y

    def get_surface_frame(stick):
        pl = stick.geometry.Plane
        X = rg.Vector3d(pl.XAxis); X.Unitize()
        Y = rg.Vector3d(pl.YAxis); Y.Unitize()
        return rg.Plane(pl.Origin, X, Y)

    def translated_surface_frame(surface_frame, origin):
        return rg.Plane(origin, surface_frame.XAxis, surface_frame.YAxis)

    # ======================================================
    # BEND GEOMETRY (IN-SURFACE)
    # ======================================================

    def compute_bend_point_in_surface(S, T, surface_frame):
        chord = rg.Vector3d(T - S)
        d = chord.Length
        if d <= 1e-9:
            return None

        chord.Unitize()
        v = rg.Vector3d.CrossProduct(surface_frame.ZAxis, chord)
        if v.Length <= 1e-6:
            return None
        v.Unitize()

        M = rg.Point3d(
            0.5 * (S.X + T.X),
            0.5 * (S.Y + T.Y),
            0.5 * (S.Z + T.Z)
        )

        h = (d * 0.5) / math.tan(math.radians(MAX_BEND_ANGLE_DEG * 0.5))
        return M + v * h

    # ======================================================
    # BRIDGE BOX (FACE-ALIGNED)
    # ======================================================

    def make_bridge_box_surface_locked(Fa, Fb, surface_frame):
        v = Fb.Origin - Fa.Origin
        if v.Length <= 1e-6:
            return None

        x = rg.Vector3d(v); x.Unitize()
        y = rg.Vector3d(surface_frame.YAxis); y.Unitize()

        pl = rg.Plane(Fa.Origin, x, y)

        box = rg.Box(
            pl,
            rg.Interval(0, v.Length),
            rg.Interval(-BOX_WIDTH * 0.5, BOX_WIDTH * 0.5),
            rg.Interval(-BOX_DEPTH * 0.5, BOX_DEPTH * 0.5)
        )
        return box.ToBrep()

    # ======================================================
    # MODE A — SURFACE-LOCKED TERMINAL PAIRING
    # ======================================================

    bridge_mode_A = []

    for layer in layered_groups:

        terminals = []

        Y = layer.get("Y", {}).get("sticks", [])
        Z = layer.get("Z", {}).get("sticks", [])

        if Y:
            terminals.append(Y[-1])
        if Z:
            terminals.append(Z[-1])

        if len(terminals) < 2:
            continue

        for i in range(len(terminals)):
            si = terminals[i]
            sid_i = getattr(si, "surface_id", None)

            for j in range(i + 1, len(terminals)):
                sj = terminals[j]
                sid_j = getattr(sj, "surface_id", None)

                # -------- SURFACE ID LOCK --------
                print("surface_id:", sid_i, sid_j)
                if sid_i is None or sid_j is None:
                    continue
                if sid_i != sid_j:
                    continue
                # --------------------------------

                S = stick_mid_face_origin(si, +1)
                T = stick_mid_face_origin(sj, -1)

                d = S.DistanceTo(T)
                print("PAIR", sid_i, sid_j, "distance:", round(d, 2))

                if d > max_distance:
                    continue

                surface_frame = get_surface_frame(si)

                F_S = translated_surface_frame(surface_frame, S)
                F_T = translated_surface_frame(surface_frame, T)

                if d <= TWO_SEG_THRESHOLD:
                    b = make_bridge_box_surface_locked(F_S, F_T, surface_frame)
                    if b:
                        bridge_mode_A.append(b)
                else:
                    B = compute_bend_point_in_surface(S, T, surface_frame)
                    if B is None:
                        continue

                    F_B = translated_surface_frame(surface_frame, B)

                    for b in (
                        make_bridge_box_surface_locked(F_S, F_B, surface_frame),
                        make_bridge_box_surface_locked(F_B, F_T, surface_frame)
                    ):
                        if b:
                            bridge_mode_A.append(b)

except Exception:
    print(traceback.format_exc())
    bridge_mode_A = []
# ---------- end bridging_mode_a ----------
panel_4 = Panel(bridging_mode_a.bridge_mode_A)
swatch_9 = ColourSwatch(SwatchColor=RGB(115, 133, 187))  # disabled
preview_8 = CustomPreview(Geometry=bridging_mode_b.bridge_mode_B, Material=swatch_9)  # disabled
preview_9 = CustomPreview(Geometry=bridging_mode_a.bridge_mode_A, Material=ColourSwatch(SwatchColor=RGB(222, 15, 187)))
swatch_10 = ColourSwatch(SwatchColor=RGB(42, 205, 189))  # disabled
preview_10 = CustomPreview(Geometry=bridging_mode_c.bridge_mode_C, Material=swatch_10)  # disabled

# ----
crv = Curve(<curve referenced from the Rhino model>)  # disabled
midpt = CurveMiddle(Curve=draw_3)
points = PointList(Points=midpt, Size=Slider(33, range=0..100))

surface_lists = Python3Script(rootplanes=gen_rhplanes.rootplanes)  # -> out, Surfaces, index_dots, local_planes; inputs rootplanes: tree of Plane
# ---------- surface_lists: Python ----------
from Grasshopper import DataTree
from Grasshopper.Kernel.Data import GH_Path
import Rhino.Geometry as rg


planes_by_surface = []

for i in range(rootplanes.BranchCount):
    branch = rootplanes.Branch(i)
    planes_by_surface.append(list(branch))



Surf_1 = planes_by_surface[0] if rootplanes.BranchCount > 0 else []
Surf_2 = planes_by_surface[1] if rootplanes.BranchCount > 1 else []
Surf_3 = planes_by_surface[2] if rootplanes.BranchCount > 2 else []
Surf_4 = planes_by_surface[3] if rootplanes.BranchCount > 3 else []

#group YZ per surface

Surf_0 = {
    "Y": [],
    "Z": []
}

def split_YZ(planes):
    Y = []
    Z = []
    for i, pl in enumerate(planes):
        if i % 2 == 0:
            Y.append(pl)
        else:
            Z.append(pl)
    return {"Y": Y, "Z": Z}

Surf_1 = split_YZ(Surf_1)
Surf_2 = split_YZ(Surf_2)
Surf_3 = split_YZ(Surf_3)
Surf_4 = split_YZ(Surf_4)

Surfaces = {
    0: split_YZ(Surf_1),
    1: split_YZ(Surf_2),
    2: split_YZ(Surf_3),
    3: split_YZ(Surf_4),
}

# visuals



index_dots = []

def label_planes(surf_id, surf_dict):
    dots = []

    for fam in ["Y", "Z"]:
        planes = surf_dict[fam]
        for i, pl in enumerate(planes):
            pt = pl.Origin
            text = f"S{surf_id} | {fam} | {i}"
            dot = rg.TextDot(text, pt)
            dots.append(dot)

    return dots

index_dots.extend(label_planes(1, Surf_1))
index_dots.extend(label_planes(2, Surf_2))
index_dots.extend(label_planes(3, Surf_3))
index_dots.extend(label_planes(4, Surf_4))

# local planes
local_planes = []

for surf_id, surf in enumerate([Surf_1, Surf_2, Surf_3, Surf_4], start=1):
    for fam in ["Y", "Z"]:
        for pl in surf[fam]:
            local_planes.append(
                rg.PlaneSurface(pl, rg.Interval(-10,10), rg.Interval(-10,10))
            )
# ---------- end surface_lists ----------
metadata = Python3Script(flat_sticks=branching.flat_sticks, Surfaces=surface_lists.Surfaces, query_index=Slider(0, range=0..10))  # -> out, stick_metadata, info; inputs query_index: Int32
# ---------- metadata: Python ----------
# ----------------------------
# NORMALIZE flat_sticks FIRST
# ----------------------------
if flat_sticks is None:
    flat_sticks = []

elif hasattr(flat_sticks, "BranchCount"):
    sticks = []
    for i in range(flat_sticks.BranchCount):
        sticks.extend(list(flat_sticks.Branch(i)))
    flat_sticks = sticks

elif not isinstance(flat_sticks, list):
    flat_sticks = [flat_sticks]

# ----------------------------
# SAFE DEBUG (after normalize)
# ----------------------------
n = len(flat_sticks)
info = f"len={n} | idx={query_index}"

# ----------------------------
# INSPECT (CLAMPED)
# ----------------------------
if n == 0:
    info = "No sticks yet"

elif query_index is None:
    info = "No index"

else:
    idx = int(query_index)

    # clamp index to valid range
    if idx < 0:
        idx = 0
    if idx >= n:
        idx = n - 1

    s = flat_sticks[idx]
    info = (
        f"Stick #{idx}\n"
        f"Surface ID: {s.surface_id}\n"
        f"Surface Type: {s.surface_type}\n"
        f"Layer: {s.layer}\n"
        f"Family: {s.family}\n"
        f"Frame Index: {s.frame_index}"
    )
# ---------- end metadata ----------
py3_2 = Python3Script(flat_sticks=branching.flat_sticks)  # -> out, labels, points; inputs flat_sticks: tree
# ---------- py3_2: Python ----------
import Rhino.Geometry as rg

labels = []
points = []

# ----------------------------
# NORMALIZE flat_sticks
# ----------------------------
if flat_sticks is None:
    flat_sticks = []

elif hasattr(flat_sticks, "BranchCount"):
    sticks = []
    for i in range(flat_sticks.BranchCount):
        sticks.extend(list(flat_sticks.Branch(i)))
    flat_sticks = sticks

elif not isinstance(flat_sticks, list):
    flat_sticks = [flat_sticks]

# ----------------------------
# CREATE INDEX LABELS
# ----------------------------
for i, s in enumerate(flat_sticks):

    # choose a stable point to label
    # prefer frame point, fallback to geometry bbox
    if hasattr(s, "frame") and s.frame:
        pt = rg.Point3d(
            s.frame.point.x,
            s.frame.point.y,
            s.frame.point.z
        )
    elif hasattr(s, "geometry") and s.geometry:
        bbox = s.geometry.GetBoundingBox(True)
        pt = bbox.Center
    else:
        continue

    dot = rg.TextDot(str(i), pt)

    labels.append(dot)
    points.append(pt)
# ---------- end py3_2 ----------
panel_5 = Panel(metadata.info)
preview_11 = CustomPreview(Geometry=surface_lists.index_dots, Material=ColourSwatch(SwatchColor=RGB(124, 171, 255)))

list_pts = RemoteSender()  # disabled
py3_3 = Python3Script()  # -> out, a; unedited script template
geo_4 = Geometry(list_pts)  # disabled

remote_receiver = RemoteReceiver()  # disabled
panel_6 = Panel(remote_receiver)  # disabled

list_pts_2 = RemoteReceiver(list_pts)  # disabled
